# Grasshopper definition Test_Drawing.gh (Grasshopper 1.0.7)
# plug-ins: Robots, Kangaroo2 Components

crv = Curve([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])
scale = Scale(Geometry=crv, Center=Point(0, 0, 0), Factor=Slider(2, range=0..100))  # -> Geometry, Transform
lng = ListLength(List=scale.Geometry)
division = Division(A=lng, B=Slider(4, range=0..10))
random = Random(Range=lng, Number=1, Seed=2)
cull_i = CullIndex(List=scale.Geometry, Indices=random, Wrap=True)
repeat = RepeatData(Data=cull_i, Length=division)
simplify = SimplifyCurve(Curve=repeat, Tolerance=Slider(1, range=0..10))  # -> Curve, Simplified
group = Group(Objects=simplify.Curve)
bbox = BoundingBox(Content=group, Plane=PlaneXY(0, 0, 0))  # -> Box, Box_2
end = EndPoints(Curve=simplify.Curve)  # -> Start, End
volume = Volume(Geometry=bbox.Box)  # -> Volume, Centroid
vec2pt = Vector2Pt(PointA=volume.Centroid, PointB=end.Start, Unitize=False)  # -> Vector, Length
sort = SortList(Keys=vec2pt.Vector, ValuesA=simplify.Curve)  # -> Keys, ValuesA
divdist = DivideDistance(Curve=sort.ValuesA, Distance=Slider(1, range=0..100))  # -> simplify(Points), Tangents, Parameters
panel = Panel(divdist.Points)
item = ListItem(List=divdist.Points, Index=Slider(0, range=0..1), Wrap=True)
item_2 = ListItem(List=divdist.Points, Index=Slider(-1, range=-1..1), Wrap=True)
panel_2 = Panel(item)
panel_3 = Panel(item_2)
Z = UnitZ(Factor=Slider(20, range=0..100))
move = Move(Geometry=item_2, Motion=Z)  # -> Geometry, Transform
move_2 = Move(Geometry=item, Motion=Z)  # -> Geometry, Transform
panel_4 = Panel(move.Geometry)
ins = InsertItems(List=divdist.Points, Item=move_2.Geometry, Indices=Slider(0, range=0..100), Wrap=True)  # -> simplify(List)
panel_5 = Panel(ins)
ins_2 = InsertItems(List=ins, Item=move.Geometry, Indices=Slider(-1, range=-100..100), Wrap=True)  # -> flatten(List)
panel_6 = Panel(ins_2)
points = PointList(Points=ins_2, Size=Slider(5, range=0..10))
crv_2 = Curve([<curve referenced from the Rhino model> x5000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])
explode = Explode(Curve=crv_2, Recursive=True)  # -> Segments, Vertices
flame = Point([Point(-625.8436067, -138.8120298, 189.9989139), Point(-626.762739, -136.734961, 189.9989139), Point(-627.8332922, -134.7317335, 189.9989139), Point(-629.0548296, -132.8169172, 189.9989139), Point(-630.4314384, -131.0105155, 189.9989139), Point(-631.9673034, -129.3376288, 189.9989139)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])
sample_text = Point([Point(-921.7377163, -245.7748352, 189.9989139), Point(-921.457464, -245.7748352, 189.9989139), Point(-921.1772117, -245.7748352, 189.9989139), Point(-920.8969594, -245.7748352, 189.9989139), Point(-920.6167071, -245.7748352, 189.9989139), Point(-920.3364548, -245.7748352, 189.9989139)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])
vec = VectorXYZ(
    XComponent=Slider(-900, range=-2000..1000),
    YComponent=Slider(-100, range=-2000..1000),
    ZComponent=Slider(189.02, range=-2000..2000))  # -> Vector, Length
list = RobotsLibrary(
    {"CITA-IRB1600-145 + Turntable", "CITA-IRB1600-145 + IRB140", "CITA-IRB1600-145", "CITA-IRB140", "CITA-UR5e", "iaac-KR150-2_110", "iaac-IRB140", "iaac-IRB120", "Penn State IRB120", "Penn State IRB2400-16", "Taiwan-IRB1600", "Taiwan-KR6", "Taiwan-KR10", "TUDelft-LAMA-UR5", "UR3e", "UR5e", "UR10e", "UR16e", "UR3", "UR5", "UR10"}, selected="UR10e",
    Type=0)
pt = Point(<point referenced from the Rhino model>)
weight_in_kg = Slider(0.1, range=0..10)
weight_in_kg_2 = Slider(0.1, range=0..10)
pt_2 = ConstructPoint(XCoordinate=Slider(8, range=0..100), YCoordinate=0, ZCoordinate=Slider(76, range=0..100))
pt_3 = ConstructPoint(XCoordinate=Slider(106.5, range=0..150), YCoordinate=0, ZCoordinate=Slider(23, range=0..100))
pt_4 = Point(<point referenced from the Rhino model>)
move_3 = Move(Geometry=ins_2, Motion=vec.Vector)  # -> Geometry, Transform
penholderhorizontal = Mesh(<mesh referenced from the Rhino model>)
penholderverical = Mesh(<mesh referenced from the Rhino model>)
yz = YZPlane(Origin=move_3.Geometry)

# ---- group: Home Start/End
home = Point(Point(-496.7146069, -174.1975795, 932.4136834))
xy = XYPlane(Origin=pt_4)
pflip = FlipPlane(Plane=xy, ReverseX=False, ReverseY=False, SwapAxes=True)

# ----
xy_2 = XYPlane(Origin=pt_2)
xy_3 = XYPlane(Origin=pt_3)

# ---- group: Geometry to print
pt_5 = Point([Point(775.7042119, 196.096571, 60), Point(772.586491, 205.5981402, 60), Point(767.285146, 214.0772758, 60), Point(760.1104062, 221.0431288, 60), Point(751.4775895, 226.0903535, 60), Point(741.8880614, 228.9260107, 60)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])
xy_4 = XYPlane(Origin=move_3.Geometry)
pflip_2 = FlipPlane(Plane=xy_4, ReverseX=False, ReverseY=False, SwapAxes=True)

# ----
loadrobot = LoadRobotSystem(Name=list, Base=PlaneXY(0, 0, 0))
panel_7 = Panel("popup(\"Press CONTINUE to start the program\",\"StartConfirmation\",warning=False,error=False, blocking=True)")
tool = CreateTool(Name="Tool_1", TCP=xy_2, Weight=weight_in_kg, Mesh=penholderverical)  # -> Tool, TCP
tool_2 = CreateTool(Name="Tool_2", TCP=xy_3, Weight=weight_in_kg_2, Mesh=penholderhorizontal)  # -> Tool, TCP
mm = Slider(1, range=0..10)
list_2 = FlagFields({"Shoulder": 1, "Elbow": 2, "Wrist": 4}, selected=[])
yz_2 = YZPlane(Origin=pt_4)
list_3 = ValueList({"Joint", "Linear"}, selected="Linear")
number_slider = Slider(150, range=0..200)
rotate = Rotate(Geometry=pflip_2, Angle=degrees(Slider(270, range=0..360)), Plane=yz)  # -> Geometry, Transform
tool_3 = ToolParameter(tool_2.Tool)
rotate_2 = Rotate(Geometry=pflip, Angle=degrees(Slider(270, range=0..360)), Plane=yz_2)  # -> Geometry, Transform
zone = ZoneParameter(mm)
customcmd = CustomCommand(Name="CustomCommand", Manufacturer="UR", Code=panel_7)
target = CreateTarget(Plane=rotate_2.Geometry, RobConf=list_2, Tool=tool_3, Speed=number_slider, IsCartesian=True)
target_2 = CreateTarget(Plane=rotate.Geometry, RobConf=list_2, Motion=list_3, Tool=tool_3, Speed=number_slider, Zone=zone, IsCartesian=True)
merge = Merge(Data1=target, Data2=target_2, Data3=target)
program = CreateProgram(Name="Drawing3", RobotSystem=loadrobot, Targets=merge, InitCommands=customcmd, StepSize=1)  # -> Program, Code, Duration, Warnings, Errors
panel_8 = Panel(program.Warnings)
panel_9 = Panel(program.Code)
panel_10 = Panel(program.Duration)
start = Button()
pause = Button()
play = Button()
panel_11 = Panel("sftp://169.254.186.138")
sim = ProgramSimulation(Program=program.Program, Time=Slider(0, range=0..1), Normalized=True)  # -> SystemMeshes, JointRotations, Plane, Index, Time, Program, Errors
remote = RemoteConnection(Program=program.Program, IP="169.254.186.138", Upload=start, Play=play, Pause=pause)
trail = SimpleTrail(Program=sim.Program, Length=500, MechanicalGroup=0)

# ---- group: Extruding Path
brep = Brep(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)
number_slider_2 = Slider(10, range=0..10)
contour = Contour(Shape=brep, Point=Point(0, 0, 0), Direction=Vector(0, 0, 1), Distance=Slider(20, range=0..100))  # disabled
divide = DivideCurve(Curve=flatten(explode.Segments), Count=Slider(1, range=0..1000), Kinks=False)  # -> flatten(Points), Tangents, Parameters

# ----
duppt = RemoveDuplicatePts(Points=divide.Points, Tolerance=Slider(1, range=0..1))  # -> flatten(UniquePoints)

# ---- group: Extruding Path (continued)
shift = ShiftList(List=duppt, Shift=1, Wrap=False)  # -> flatten(List)
intcrv = Interpolate(Vertices=flatten(shift), Degree=3, Periodic=False, KnotStyle=1)  # -> flatten(Curve), Length, Domain
divdist_2 = DivideDistance(Curve=intcrv.Curve, Distance=Slider(10, range=0..10))  # -> flatten(Points), Tangents, Parameters

# ----
pt_6 = Point(duppt)

# ---- group: Set tool rotation to follow the normals of a curve (but doesn't work here)
pframe = PerpFrame(Curve=intcrv.Curve, Parameter=divdist_2.Parameters)  # -> flatten(Frame)
hframe = HorizontalFrame(Curve=intcrv.Curve, Parameter=divdist_2.Parameters)  # -> flatten(Frame)
